% Simulink data dictionary Definitions.sldd
% references TestConfig.sldd

bbbBus = Simulink.Bus()
  cc: Bus: ccBus
  dd: Bus: ddBus

ccBus = Simulink.Bus()
  f: double[2 2]
  g: double

bbBus = Simulink.Bus()
  d: uint32
  e: double

aaaBus = Simulink.Bus()
  c: int8
  bb: Bus: bbBus

aaBus = Simulink.Bus()
  a: Enum: MyEnum
  b: int16

aaaaBus = Simulink.Bus()
  aa: Bus: aaBus
  aaa: Bus: aaaBus
  bbb: Bus: bbbBus
  j: Enum: MyEnum

ddBus = Simulink.Bus()
  h: boolean
  i: single

MyEnum = enum(DefaultValue="A")
  A = 0
  B = 1
  C = 2
  D = 3
  E = 4
  F = 5
  G = 6
  H = 7
  I = 8
  J = 9
  K = 10
  L = 11